vi "Main Window.gvi"   [LabVIEW NXG 5.0.0]
panel controls:
  "Acquire Button": bool
  "Load Measurement": bool
  "Save Measurement": bool
  "IV Curve Parameters": "IV Curve Parameters.gtype"
  "Cell Selector": "Cell Selector.gtype"
  "Main Tab": i32
  "Custom date": bool
  "Author Initials": string
  "Batch Name": string
  "Cell Number": string
  "Sample Comments": string
  "Abort Button": bool
  "Exit App Button": bool
  "Add Layer Button": bool
  "Add Layer Button_2": bool
  "Add Layer Button_3": bool
  "Queue In": Queue<"Queue Instructions Control.gtype">
  "Label Info Error Label": string
  "Label Info Missing Error": bool
  "Config Tab": i32
  "Misc Data Mega Cluster": "Misc Mega Cluster.gtype"
  "Instrument Control Mega Cluster": "Instrument Control Mega Cluster.gtype"
  "Desired Cell": "Cell Selector.gtype" = "L.01"
  "Set Cell": bool
  "Cell Parameters": "Cell Parameters.gtype" = {"Max (V)"=1, "Min (V)"=-0.2, "Sweep Dir"=FALSE, "Curr Range (A)"=0.1, "Autorange"=TRUE, "Max (A)"=1, "Cell Area (m^2)"=8e-06, "Light Power (W m^-2)"=1000}
  "IV Mode": "IV Mode.gtype" = "Rough"
  "Measurement Precision": "Accuracy Parameters.gtype" = {"V Points"=100, "Current Avg"=3, "Integration Time"=0.5, "Iterations"=1}
panel indicators:
  "Current Date": string
  "Progress %": f64
  "State": string
  "Substate": string
  "Sample Prefix": string
  "Progress counter": f64
  "Layer Information": string[]
  "Live IV Parameters": "Live IV Parameters.gtype"
  "Queue Out": Queue<"Queue Instructions Control.gtype">
  "JV Main Graph": f64[]
  "Current State": "Queue Instructions Control.gtype"
  "Elapsed Time (kr)": f64
  "Estimated Time (kr)": f64
types:
  "Cell Parameters.gtype" = cluster{"Max (V)": f64, "Min (V)": f64, "Sweep Dir": bool, "Curr Range (A)": f64, "Autorange": bool, "Max (A)": f64, "Cell Area (m^2)": f64, "Light Power (W m^-2)": f64}
  "Accuracy Parameters.gtype" = cluster{"V Points": u32, "Current Avg": u32, "Integration Time": f64, "Iterations": u32}
  "IV Mode.gtype" = enum{"Rough", "Normal", "Accurate", "Smart", "Custom"}
  "IV Curve Parameters.gtype" = cluster{"Cell Parameters": "Cell Parameters.gtype", "Measurement Precision": "Accuracy Parameters.gtype", "IV Accuracy Mode": "IV Mode.gtype"}
  T1 = cluster{"L.01": bool, "R.01": bool, "L.02": bool, "R.02": bool, "L.03": bool, "R.03": bool, "L.04": bool, "R.04": bool, "L.05": bool, "R.05": bool, "L.06": bool, "R.06": bool, "L.07": bool, "R.07": bool, "L.08": bool, "R.08": bool, "L.09": bool, "R.09": bool, "L.10": bool, "R.10": bool, "L.11": bool, "R.11": bool, "L.12": bool, "R.12": bool}
  "Cell Selector.gtype" = cluster{"All": bool, "Left": bool, "Right": bool, "Cell Cluster": T1, "Reset": bool, "Random Order ": bool, "Continuous Cell": bool}
  "Live IV Parameters.gtype" = cluster{"Current (A)": f64, "Voltage (V)": f64, "Current Density (A/m^2)": f64, "Current Cell": enum{""}}
  "Queue Instructions Control.gtype" = enum{"Undefined State", "Debug Check", "Initialize App", "Idle", "Change Cell", "IV Curves Acquisition", "Saving TXT Files", "Generating Origin Files", "Stopping App", "State 1", "State2", "State3", "State4", "State5"}
  "Full Reference Cluster.gtype" = cluster{"Sample Extra Information": "Sample extra imformation.gtype", "Acquisition Parameters": "Acquisition Parameters.gtype", "Status Report": "Status Report.gtype", "Live Progress": "Live Progress.gtype", "Sample Naming Cluster": "Sample Naming Cluster.gtype"}
  "Misc Mega Cluster.gtype" = cluster{"Full Reference Cluster": "Full Reference Cluster.gtype"}
  T2 = cluster{"Element 1": "VISA Instr", "Element 2": string}
  T3 = enum{"Keithley 2400 Series", "Keithley 2450 Series"}
  "Instrument Control.gtype" = cluster{"Multiplexer Arduino Detected?": bool, "Multiplexer Arduino Address": "VISA Instr", "Arduinos List": T2[], "Multiplexer Log": string, "Keythley Address": "VISA Instr", "Keithley Detected?": bool, "Keithley ID": string, "Detected Keithley Type": T3}
  "Debugging Cluster.gtype" = cluster{"Debugging mode?": bool, "Initialize App": bool, "Insturment Debugging": cluster{"Keithley": bool, "Arduino": bool}}
  "Instrument Control Mega Cluster.gtype" = cluster{"Instrument Control": "Instrument Control.gtype", "Debugging Cluster": "Debugging Cluster.gtype"}
  "Acquisition Parameters.gtype" = cluster{"Cell Selector": "Cluster reference", "Cell Parameters Ref": "Cluster reference", "IV Mode Ref": "EnumSelector reference", "Measurement Precision Ref": "Cluster reference"}
  "Sample Naming Cluster.gtype" = cluster{"Author Initials": "ComboBoxSelector reference", "Batch Name": "StringControl reference", "Cell Number": "StringControl reference", "Current Date": "StringControl reference", "Sample Comments": "StringControl reference", "Sample Prefix": "StringControl reference", "Custom Date": "CheckBox reference", "Label Info Error Label Ref": "StringControl reference", "Label Info Missing Error Ref": "BooleanControl reference"}
  "Status Report.gtype" = cluster{"State": "StringControl reference", "Substate": "StringControl reference", "Current State Ref": "EnumSelector reference", "Main Tab Reference": "TabControl reference"}
  "Live Progress.gtype" = cluster{"Progress %": "ProgressBar reference", "Progress Counter": "NumericTextBoxDouble reference", "Live IV Parameters": "Cluster reference"}
  "Sample extra imformation.gtype" = cluster{"Layer Information": "ArrayViewer reference"[]}
uses:
  Pika IV Characterization NXG::Side Functions::Abort Control::FGV Global Abort.gvi
  Pika IV Characterization NXG::Main Functions::Instruction Handling::FGV Current State.gvi
  Pika IV Characterization NXG::Side Functions::Timeout::FGV Progress.gvi
  Pika IV Characterization NXG::Side Functions::Timeout::Timeout Subroutine.gvi
  Pika IV Characterization NXG::Side Functions::Exit App Sequence.gvi
  Pika IV Characterization NXG::Side Functions::Utilities::Cell Naming::Sample Naming Subroutine.gvi
  Pika IV Characterization NXG::Side Functions::Utilities::Cell Naming::FGV Sample Prefix.gvi
  Pika IV Characterization NXG::Main Functions::Instruction Handling::Check Queue And Label.gvi
  Pika IV Characterization NXG::Main Functions::Instruction Handling::Condition Enqueue.gvi
  Pika IV Characterization NXG::Main Functions::IV Curves::IV Operation Translation.gvi
  Pika IV Characterization NXG::Side Functions::Instrument Control::Arduino Multiplexer::Set Cell Requisites.gvi
  NI::G Core::Error::Is Error.gvi
  Pika IV Characterization NXG::Side Functions::Abort Control::Abort Sequence.gvi
  Pika IV Characterization NXG::Side Functions::Debugging::Debugging Prompt.gvi
  Pika IV Characterization NXG::Main Functions::Initializing App::Initialize App Subroutine.gvi
  Pika IV Characterization NXG::Side Functions::Instrument Control::Arduino Multiplexer::Set Cell Subroutine.gvi
  NI::G Core::Error::Multiplex Errors.gvi
  NI::G Core::Error::Display Error.gvi
diagram:
  case (TRUE) {
    frame False, Default {
      w1 = default
    }
    frame True {
      Property Node(instance in="Acquisition Parameters.gtype" {all zero or empty}, "Cell Selector"=reference to "Cell Selector", "Measurement Precision Ref"=reference to "Measurement Precision", "Cell Parameters Ref"=reference to "Cell Parameters", "IV Mode Ref"=reference to "IV Mode") -> (instance out=w2)
      Property Node(instance in="Sample Naming Cluster.gtype" {all zero or empty}, "Author Initials"=reference to "Author Initials", "Batch Name"=reference to "Batch Name", "Cell Number"=reference to "Cell Number", "Current Date"=reference to "Current Date", "Sample Comments"=reference to "Sample Comments", "Sample Prefix"=reference to "Sample Prefix", "Custom Date"=reference to "Custom date", "Label Info Error Label Ref"=reference to "Label Info Error Label", "Label Info Missing Error Ref"=reference to "Label Info Missing Error") -> (instance out=w3)
      Property Node(instance in="Status Report.gtype" {all zero or empty}, "State"=reference to "State", "Substate"=reference to "Substate", "Current State Ref"=reference to "Current State", "Main Tab Reference"=reference to "Main Tab") -> (instance out=w4)
      Property Node(instance in="Live Progress.gtype" {all zero or empty}, "Progress %"=reference to "Progress %", "Progress Counter"=reference to "Progress counter", "Live IV Parameters"=reference to "Live IV Parameters") -> (instance out=w5)
      Property Node(instance in="Sample extra imformation.gtype" {all zero or empty}, "Layer Information"=reference to "Layer Information") -> (instance out=w6)
      Property Node(instance in="Full Reference Cluster.gtype" {all zero or empty}, "Sample Extra Information"=w6, "Acquisition Parameters"=w2, "Status Report"=w4, "Live Progress"=w5, "Sample Naming Cluster"=w3)
      w1 = no error
    }
  }
  call "FGV Global Abort.gvi"(Global Abort Instructions="Reset State", Error In=w1) -> (Error Out=w7)
  call "FGV Current State.gvi"(Current State Instructions="Set Current State and Substate", Current State="Undefined State", Current Substate="Starting Up", Error In=w7) -> (Error Out=w8)
  Obtain Queue(create if not found=TRUE, element data type="Queue Instructions Control.gtype" "Undefined State", error in=w8, name="Instruction Queue") -> (error out=w9, queue out=w10)
  Enqueue Element(element="Debug Check", error in=w9, queue=w10) -> (error out=w11, queue out=w12)
  s1 = w12  # shift register
  while {
    event (timeout = 50) {
      on "Timeout" {
        call "FGV Progress.gvi"(FGV Instructions="Read State", Error In=w11) -> (Progress Out=w16, Elapsed Time Out (kr)=w17, Estimated Time Out (kr)=w18, Error Out=w19)
        $"Progress %" <- w16
        $"Progress counter" <- w16
        $"Estimated Time (kr)" <- w18
        call "Timeout Subroutine.gvi"(Queue In=s1, Misc Data Mega Cluster In=$"Misc Data Mega Cluster", Error In=w19) -> (Queue Out=w14, Misc Data Mega Cluster Out=w20, Stop App?=w15, Error Out=w13)
        $"Misc Data Mega Cluster" <- w20
        $"Elapsed Time (kr)" <- w17
      }
      on "Exit App Button" Value changed {
        call "Exit App Sequence.gvi"(Queue In=s1, Exit App=$"Exit App Button", Error In=w11) -> (Queue Out=w14, Error Out=w13)
        w15 = default
      }
      on "Author Initials" Value changed; "Batch Name" Value changed; "Cell Number" Value changed; "Current Date" Value changed; "Custom date" Value changed; "Sample Comments" Value changed; "Sample Prefix" Value changed {
        call "Sample Naming Subroutine.gvi"(Misc Data Mega Cluster In=$"Misc Data Mega Cluster", Error In=w11) -> (Misc Data Mega Cluster Out=w21, Error Out=w22)
        $"Misc Data Mega Cluster" <- w21
        call "FGV Sample Prefix.gvi"(FGV Instructions="Set State", Misc Mega Cluster=w21, Error In=w22) -> (Error Out=w13)
        w14 = default
        w15 = default
      }
      on "Acquire Button" Value changed; "Save Measurement" Value changed {
        call "Check Queue And Label.gvi"(Label Info Error Label=$"Label Info Error Label", Label Info Missing Error=$"Label Info Missing Error", Error In=w11, Is Label Necessary?=TRUE) -> (Proceed to enqueue=w23, Error Out=w24)
        call "Condition Enqueue.gvi"(Queue In=s1, Queue Instruction="IV Curves Acquisition", Error In=w24, Equeue?=w23) -> (Queue Out=w14, Error Out=w25)
        call "IV Operation Translation.gvi"(Acquire Button=$"Acquire Button", Load Measurement=FALSE, Save Measurement=$"Save Measurement", Error In=w25) -> (Error Out=w13)
        w15 = default
      }
      on "Load Measurement" Value changed {
        call "Check Queue And Label.gvi"(Label Info Error Label=$"Label Info Error Label", Label Info Missing Error=$"Label Info Missing Error", Error In=w11, Is Label Necessary?=TRUE) -> (Proceed to enqueue=w26, Error Out=w27)
        call "Condition Enqueue.gvi"(Queue In=s1, Queue Instruction="IV Curves Acquisition", Error In=w27, Equeue?=w26) -> (Queue Out=w14, Error Out=w28)
        call "IV Operation Translation.gvi"(Acquire Button=FALSE, Load Measurement=$"Load Measurement", Save Measurement=FALSE, Error In=w28) -> (Error Out=w13)
        w15 = default
      }
      on "Set Cell" Value changed {
        call "Set Cell Requisites.gvi"(Queue In=s1, Instrument Control Mega Cluster=$"Instrument Control Mega Cluster", Error In=w11, Set Cell=$"Set Cell") -> (Queue Out=w14, Error Out=w13)
        w15 = default
      }
    }
    call "Is Error.gvi"(error in=w13) -> (error?=w29)
    Logical Or(w29, w15) -> w30
    next s1 = w14
    stop if w30
  }
  s2 = w12  # shift register
  s3 = w11  # shift register
  while {
    event (timeout = 100) {
      on "Timeout" {
        call "FGV Global Abort.gvi"(Global Abort Instructions="Read Current State", Error In=s3) -> (Global Abort Out=w34, Error Out=w35)
        Preview Queue Element(error in=w35, queue=s2, timeout in ms=100) -> (element=w36, error out=w31, queue out=w32)
        Is Equal(x=w36, y="Stopping App") -> w37
        Logical Or(w37, w34) -> w33
      }
      on "Abort Button" Value changed {
        call "Abort Sequence.gvi"(Queue In=s2, Global Abort=$"Abort Button", Error In=s3) -> (Queue Out=w32, Error Out=w31)
        w33 = default
      }
    }
    next s2 = w32
    next s3 = w31
    stop if w33
  }
  Enqueue Element(element="Stopping App", error in=s3, queue=s2) -> (error out=w38)
  s4 = w12  # shift register
  while {
    Dequeue Element(error in=w11, queue=s4) -> (element=w39, error out=w40, queue out=w41)
    case (w39) {
      frame "Undefined State", Default {
        w42 = w40
        w43 = w41
        w44 = default
      }
      frame "Debug Check" {
        call "Debugging Prompt.gvi"(Instrument Control Mega Cluster In=$"Instrument Control Mega Cluster", Error In=w40) -> (Instrument Control Mega Cluster Out=w45, Error Out=w46)
        Enqueue Element(element="Initialize App", error in=w46, queue=w41) -> (error out=w42, queue out=w43)
        $"Instrument Control Mega Cluster" <- w45
        w44 = default
      }
      frame "Initialize App" {
        call "Initialize App Subroutine.gvi"(Instrument Control Mega Cluster In=$"Instrument Control Mega Cluster", Misc Data Mega Cluster In=$"Misc Data Mega Cluster", Error In=w40) -> (Instrument Control Mega Cluster Out=w47, Misc Data Mega Cluster Out=w48, Error Out=w49)
        $"Instrument Control Mega Cluster" <- w47
        $"Misc Data Mega Cluster" <- w48
        Enqueue Element(element="Idle", error in=w49, queue=w41) -> (error out=w42, queue out=w43)
        w44 = default
      }
      frame "Idle" {
        call "FGV Global Abort.gvi"(Global Abort Instructions="Reset Local", Error In=w40) -> (Error Out=w50)
        call "FGV Current State.gvi"(Current State Instructions="Set Current State and Substate", Current State="Idle", Current Substate="Idle", Error In=w50) -> (Error Out=w51)
        call "FGV Progress.gvi"(FGV Instructions="Reset State", Error In=w51) -> (Error Out=w42)
        w43 = w41
        w44 = default
      }
      frame "Change Cell" {
        call "Set Cell Subroutine.gvi"(Instrument Control Mega Cluster In=$"Instrument Control Mega Cluster", Error In=w40) -> (Instrument Control Mega Cluster Out=w52, Error Out=w53)
        Enqueue Element(element="Idle", error in=w53, queue=w41) -> (error out=w42, queue out=w43)
        $"Instrument Control Mega Cluster" <- w52
        w44 = default
      }
      frame "Stopping App" {
        call "FGV Current State.gvi"(Current State Instructions="Set Current State and Substate", Current State="Stopping App", Current Substate="Bye Bye :D", Error In=w40) -> (Error Out=w42)
        w43 = w41
        w44 = TRUE
      }
    }
    call "Is Error.gvi"(error in=w42) -> (error?=w54)
    Logical Or(w54, w44) -> w55
    call "FGV Global Abort.gvi"(Global Abort Instructions="Reset State", Global Abort=w55, Error In=w42) -> (Error Out=w56)
    next s4 = w43
    stop if w55
  }
  Enqueue Element(element="Stopping App", error in=w56, queue=s4) -> (error out=w57)
  call "Multiplex Errors.gvi"(error in 1=w13, error in 2=w57, error in 3=w38) -> (error out=w58)
  Flush Queue(error in=w58, queue=s1) -> (error out=w59, queue out=w60)
  Release Queue(error in=w59, queue=w60) -> (error out=w61)
  case (w61) {
    frame Error, Default {
      # In case there is an error
      # put out an error handler
      call "Display Error.gvi"(error in=w61)
    }
    frame No Error { }
  }
